# Grasshopper definition GHDebugSurface.gh (Grasshopper 1.0.7)

# ---- group: SurfaceFromAGridOfPoints
srf = Surface(reparameterize(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))  # disabled
srfpt = SurfacePoints(Surface=srf)  # -> Points, Weights, Greville, UCount, VCount; disabled

# ---- group: SurfaceFrom4Points
panel = Panel("{10.0, 0.0, 0.0}")  # disabled
panel_2 = Panel("{0.0, 10.0, 4.0}")  # disabled
# All these definitions were used to convalidate and developed the GeometrySharp surfaces tests.
panel_3 = Panel("{0.0, 0.0, 0.0}")  # disabled
panel_4 = Panel("{10.0, 10.0, 2.0}")  # disabled
srf4pt = _4PointSurface(CornerA=panel_3, CornerB=panel, CornerC=panel_4, CornerD=panel_2)  # -> reparameterize(Surface); disabled

# ----
# NURBS Surface_Loose_Lofted surface_ All opened curves
number_slider = Slider(2, range=0..10)
panel_5 = Panel("""{-5.0, 25.0, 0.0}
{0.0, 25.0, 20.0}
{10.0, 25.0, 0.0}""")
panel_6 = Panel("""{-20.0, 0.0, 0.0}
{0.0, 0.0, 10.0}
{10.0, 0.0, 0.0}""")
panel_7 = Panel("""{-15.0, 10.0, 0.0}
{0.0, 10.0, 5.0}
{20.0, 10.0, 1.0}""")
panel_8 = Panel("""{-5.0, 35.0, -2.0}
{0.0, 35.0, 20.0}
{5.0, 35.0, 0.0}""")
loft_opt = LoftOptions(Closed=False, Adjust=False, Rebuild=0, Refit=0, Type=Slider(1, range=0..10))
nurbs = NurbsCurve(Vertices=panel_6, Degree=number_slider, Periodic=False)  # -> Curve, Length, Domain
nurbs_2 = NurbsCurve(Vertices=panel_7, Degree=number_slider, Periodic=False)  # -> Curve, Length, Domain
nurbs_3 = NurbsCurve(Vertices=panel_5, Degree=number_slider, Periodic=False)  # -> Curve, Length, Domain
nurbs_4 = NurbsCurve(Vertices=panel_8, Degree=number_slider, Periodic=False)  # -> Curve, Length, Domain
merge = Merge(Data1=nurbs.Curve, Data2=nurbs_2.Curve, Data3=nurbs_3.Curve, Data4=nurbs_4.Curve)
panel_9 = Panel("""{0.5,0.5,0.0}
{0.1,0.1,0.0}
{1.0,1.0,0.0}""")
loft = Loft(Curves=merge, Options=loft_opt)
evalsrf = EvaluateSurface(Surface=reparameterize(loft), Point=panel_9)  # -> Point, Normal, UDirection, VDirection, Frame
srfpt_2 = SurfacePoints(Surface=loft)  # -> Points, Weights, Greville, UCount, VCount
panel_10 = Panel(evalsrf.VDirection)
panel_11 = Panel([srfpt_2.VCount, srfpt_2.UCount])
panel_12 = Panel(evalsrf.Point)
item = ListItem(List=panel_12, Index=Slider(3, range=0..10), Wrap=True)
panel_13 = Panel(item)

panel_14 = Panel(srfpt.Weights)  # disabled
panel_15 = Panel(srfpt.Points)  # disabled

# ---- group: PointAt and VectorAt
panel_16 = Panel("""{0.5,0.5,0.0}
{0.1,0.1,0.0}
{1,1,0.0}
{0.3,0.5,0.0}""")  # disabled
evalsrf_2 = EvaluateSurface(Surface=srf, Point=panel_16)  # -> Point, Normal, UDirection, VDirection, Frame; disabled
panel_17 = Panel(evalsrf_2.VDirection)  # disabled
panel_18 = Panel(evalsrf_2.Point)  # disabled

# ---- group: RationalDerivatives
c_script = CSharpScript(srf=srf)  # -> out, derv0, dervs; inputs srf: Surface; disabled
# ---------- c_script: C# ----------
    Point3d pt;
    Vector3d[] derivis;
    srf.Evaluate(0.3, 0.5, 1, out pt, out derivis);
    dervs = derivis;
    derv0 = pt;
# ---------- end c_script ----------
panel_19 = Panel(c_script.derv0)  # disabled
panel_20 = Panel(c_script.dervs)  # disabled
